# Grasshopper definition 170721_SphereCollide_01.gh (Grasshopper 0.9.76)

mesh = Mesh([<mesh referenced from the Rhino model> x2])
facen = FaceNormals(Mesh=mesh)  # -> Centers, Normals
pl = PlaneNormal(Origin=facen.Centers, ZAxis=facen.Normals)
vdis = VectorDisplay(Anchor=facen.Centers, Vector=expr("x * 3", facen.Normals))
pln = Plane(flatten(pl))
number_slider = Slider(100000, range=0..1000000)
pt = Point(<point referenced from the Rhino model>)
pt_2 = Point(<point referenced from the Rhino model>)
box = Box2Pt(PointA=pt_2, PointB=pt, Plane=PlaneXY(0, 0, 0))

# ---- group: Particle Count
int = Integer(Slider(50000, range=0..100000))

# ----
box_2 = Box(box)
int_2 = Integer(int)
pln_2 = Plane(pln)
int_3 = Integer(int)

# ---- group: SphereCollide
c_script = CSharpScript(
    count=int_2,
    radius=Slider(0.4, range=0..1),
    weight=Slider(1, range=0..100),
    parallel=Toggle(True),
    Reference=["C:\USERS\DAVID.RE\APPDATA\ROAMING\GRASSHOPPER\LIBRARIES\SPATIALSLUR\SpatialSlur.dll", "C:\USERS\DAVID.RE\APPDATA\ROAMING\GRASSHOPPER\LIBRARIES\SPATIALSLUR\SlurRhino.dll"])  # -> out, result; inputs count: Int32, radius: Double, weight: Double, parallel: Boolean
# ---------- c_script: C# ----------
    result =  new SphereCollide(Enumerable.Range(0, count), radius, parallel, weight);
# ---------- end c_script ----------

# ---- group: AbovePlane
c_script_2 = CSharpScript(
    count=int_3,
    plane=pln_2,
    weight=Slider(100, range=0..100),
    Reference=["C:\USERS\DAVID.RE\APPDATA\ROAMING\GRASSHOPPER\LIBRARIES\SPATIALSLUR\SpatialSlur.dll", "C:\USERS\DAVID.RE\APPDATA\ROAMING\GRASSHOPPER\LIBRARIES\SPATIALSLUR\SlurRhino.dll"])  # -> out, result; inputs count: Int32, plane: Plane, weight: Double
# ---------- c_script_2: C# ----------
    var o = plane.Origin.ToVec3d();
    var n = plane.Normal.ToVec3d();
    result = new AbovePlane(Enumerable.Range(0, count), o, n, weight);
# ---------- end c_script_2 ----------

# ----
merge = Merge(
    Data1=ColourSwatch(SwatchColor=RGB(255, 255, 255)),
    Data2=ColourSwatch(SwatchColor=RGB(255, 0, 150)),
    Data3=ColourSwatch(SwatchColor=RGB(0, 0, 0)))
box_3 = Box(box_2)
int_4 = Integer(int)
dup = DuplicateData(Data=merge, Number=Slider(4, range=0..100), Order=True)

# ---- group: Settings
c_script_3 = CSharpScript(
    timeStep=Slider(1, range=0..1),
    damping=Slider(0.9, range=0..1),
    Reference=["C:\USERS\DAVID.RE\APPDATA\ROAMING\GRASSHOPPER\LIBRARIES\SPATIALSLUR\SpatialSlur.dll", "C:\USERS\DAVID.RE\APPDATA\ROAMING\GRASSHOPPER\LIBRARIES\SPATIALSLUR\SlurRhino.dll"])  # -> out, result; inputs timeStep: Double, damping: Double
# ---------- c_script_3: C# ----------
    result = new ConstraintSolverSettings(){TimeStep = timeStep, Damping = damping};
# ---------- end c_script_3 ----------

# ---- group: Particle Positions
c_script_4 = CSharpScript(
    bounds=box_3,
    count=int_4,
    seed=Slider(1, range=0..10),
    Reference=["C:\USERS\DAVID.RE\APPDATA\ROAMING\GRASSHOPPER\LIBRARIES\SPATIALSLUR\SpatialSlur.dll", "C:\USERS\DAVID.RE\APPDATA\ROAMING\GRASSHOPPER\LIBRARIES\SPATIALSLUR\SlurRhino.dll"])  # -> out, result; inputs bounds: Box, count: Int32, seed: Int32
# ---------- c_script_4: C# ----------
    var points = new Vec3d[count];

    var random = new Random(seed);
    var d = bounds.BoundingBox.ToInterval3d();

    for(int i = 0; i < count; i++)
      points[i] = random.NextVec3d(d);

    result = new GH_ObjectWrapper(points);
# ---------- end c_script_4 ----------

# ----
merge_2 = Merge(Data1=c_script_2.result, Data2=c_script.result)
col = Colour(dup)
list = ValueList({"Reset": 0, "Play": 1, "Pause": 2}, selected="Pause")
data = Data(c_script_4.result)
data_2 = Data(merge_2)
data_3 = Data(c_script_3.result)
col_2 = Colour(col)
c_script_5 = CSharpScript(
    positions=data,
    constraints=data_2,
    settings=data_3,
    subSteps=Slider(1, range=0..100),
    colors=col_2,
    pointSize=Slider(8, range=0..16),
    simState=list,
    Reference=["C:\Users\david.re\AppData\Roaming\Grasshopper\Libraries\SpatialSlur\SpatialSlur.dll", "C:\Users\david.re\AppData\Roaming\Grasshopper\Libraries\SpatialSlur\SlurRhino.dll"])  # -> out, result; inputs constraints: list, subSteps: Int32, colors: list of Color, pointSize: Int32, simState: Int32
# ---------- c_script_5: C# ----------
    //reset
    if(simState == 0)
    {
      Reset();
      return;
    }

    // setup
    if(_solver == null)
    {
      Init((IEnumerable<Vec3d>) positions);
    }

    // update constraints & settings
    _constraints = constraints.Select(obj => (IConstraint) obj).ToList();
    _solver.Settings = (ConstraintSolverSettings) settings;

    // step solver
    for(int i = 0; i < subSteps; i++)
      _solver.StepParallel(_particles, _constraints);

    // print details
    Print(String.Format("Step {0}", _solver.StepCount));

    // expire solution
    if(simState == 1)
      Component.ExpireSolution(true);

    // update display
    UpdateDisplay(colors, pointSize);
    // UpdateDisplay();
# ---------- c_script_5: C# additional code ----------
  List<Particle> _particles;
  List<IConstraint> _constraints;
  ConstraintSolver _solver;

  PointCloud _pointCloud;
  BoundingBox _clippingBox;

  Color _pointColor = Color.Black;
  int _pointSize = 8;


  /// <summary>
  ///
  /// </summary>
  /// <returns></returns>
  void Reset()
  {
    _solver = null;
    _pointCloud = null;
  }


  /// <summary>
  ///
  /// </summary>
  /// <param name="particlePositions"></param>
  /// <param name="constraints"></param>
  /// <returns></returns>
  void Init(IEnumerable<Vec3d> particlePositions)
  {
    _particles = particlePositions.Select(p => new Particle(p)).ToList();
    _solver = new ConstraintSolver();
    InitDisplay();
  }


  /// <summary>
  ///
  /// </summary>
  /// <returns></returns>
  void InitDisplay()
  {
    _pointCloud = new PointCloud(_particles.Select(p => p.Position.ToPoint3d()));
    _clippingBox = _pointCloud.GetBoundingBox(false);
  }


  /// <summary>
  ///
  /// </summary>
  /// <returns></returns>
  void UpdateDisplay(List<Color> colors, int pointSize)
  {
    var interval = UpdateParticleDistances();

    // update point cloud items
    var chunks = System.Collections.Concurrent.Partitioner.Create(0, _particles.Count);
    System.Threading.Tasks.Parallel.ForEach(chunks, range =>
      {
      for(int i = range.Item1; i < range.Item2; i++)
      {
        var p0 = _particles[i];
        var p1 = _pointCloud[i];

        var pt = p0.Position.ToPoint3d();
        p1.Location = pt;
        p1.Color = colors.Lerp(interval.Normalize(p0.Distance));
      }
      });

    _clippingBox = _pointCloud.GetBoundingBox(false);
    _pointSize = pointSize;
  }


  /// <summary>
  /// Returns distance interval
  /// </summary>
  /// <returns></returns>
  Interval1d UpdateParticleDistances()
  {
    var camPos = RhinoDocument.Views.ActiveView.ActiveViewport.CameraLocation.ToVec3d();
    var interval = new Interval1d(camPos.DistanceTo(_particles[0].Position));

    foreach(var p in _particles)
    {
      var d = camPos.DistanceTo(p.Position);
      interval.Include(d);
      p.Distance = d;
    }

    return interval;
  }


  /// <summary>
  ///
  /// </summary>
  /// <returns></returns>
  void UpdateDisplay()
  {
    _clippingBox = BoundingBox.Empty;

    for(int i = 0; i < _particles.Count; i++)
    {
      var pt = _particles[i].Position.ToPoint3d();
      _pointCloud[i].Location = pt;
      _clippingBox.Union(pt);
    }
  }


  /// <summary>
  ///
  /// </summary>
  public override BoundingBox ClippingBox
  {
    get {return _clippingBox;}
  }


  /// <summary>
  ///
  /// </summary>
  /// <param name="args"></param>
  /// <returns></returns>
  public override void DrawViewportWires(IGH_PreviewArgs args)
  {
    if(_pointCloud != null)
      args.Display.DrawPointCloud(_pointCloud, _pointSize, _pointColor);
  }


  /// <summary>
  /// Extended particle that holds additional information for display purposes.
  /// </summary>
  class Particle : SpatialSlur.SlurDynamics.Particle
  {
    public double Distance;


    /// <summary>
    ///
    /// </summary>
    /// <param name="position"></param>
    public Particle(Vec3d position)
      :base(position)
    {
    }
  }
# ---------- end c_script_5 ----------
panel = Panel(c_script_5.out)
