# Grasshopper definition IDWField_Example.gh (Grasshopper 0.9.76)

merge = Merge(Data1=Slider(0.5, range=0..1), Data2=Slider(0, range=0..1), Data3=Slider(1, range=0..1), Data4=Slider(0, range=0..1))
pt = Point([<point referenced from the Rhino model> x4])

# ---- group: Create IDWField
c_script = CSharpScript(
    points=pt,
    values=merge,
    power=Slider(2.28, range=0..10),
    Reference="C:\USERS\DAVID.RE\APPDATA\ROAMING\GRASSHOPPER\LIBRARIES\SPATIALSLUR\SpatialSlur.dll")  # -> out, result; inputs points: list of Point3d, values: list of Double, power: Double
# ---------- c_script: C# ----------
    var field = IDWField3d.Double.Create(power);
    var fp = field.Points;

    for(int i = 0; i < points.Count; i++)
      fp.Add(points[i], values[i]);

    result = new GH_ObjectWrapper(field);
# ---------- end c_script ----------

# ----
merge_2 = Merge(
    Data1=ColourSwatch(SwatchColor=RGB(255, 255, 255)),
    Data2=ColourSwatch(SwatchColor=RGB(255, 0, 150)),
    Data3=ColourSwatch(SwatchColor=RGB(0, 0, 0)))
data = Data(c_script.result)
mesh = Mesh(<mesh referenced from the Rhino model>)

# ---- group: Field Painter
c_script_2 = CSharpScript(
    field=data,
    mesh=mesh,
    colors=merge_2,
    Reference="C:\USERS\DAVID.RE\APPDATA\ROAMING\GRASSHOPPER\LIBRARIES\SPATIALSLUR\SpatialSlur.dll")  # -> out, result; inputs mesh: Mesh, colors: list of Color
# ---------- c_script_2: C# ----------
    var f = (IField3d<double>) field;
    var verts = mesh.Vertices;

    mesh.ColorVertices(i => colors.Lerp(f.ValueAt(verts[i])), true);

    result = mesh;
# ---------- end c_script_2 ----------
