# Grasshopper definition Sphere_Collide_01.gh (Grasshopper 0.9.76)

mesh = Mesh([<mesh referenced from the Rhino model> x3])
facen = FaceNormals(Mesh=mesh)  # -> Centers, Normals
pt = Point(<point referenced from the Rhino model>)
pt_2 = Point(<point referenced from the Rhino model>)
pl = PlaneNormal(Origin=facen.Centers, ZAxis=facen.Normals)
vdis = VectorDisplay(Anchor=facen.Centers, Vector=expr("x * 3", facen.Normals))
box = Box2Pt(PointA=pt_2, PointB=pt, Plane=PlaneXY(0, 0, 0))
pln = Plane(flatten(pl))

# ---- group: Particle Count
int = Integer(Slider(30000, range=0..100000))

# ----
box_2 = Box(box)
int_2 = Integer(int)
pln_2 = Plane(pln)
int_3 = Integer(int)

# ---- group: SphereCollide Force
c_script = CSharpScript(
    count=int_2,
    radius=Slider(0.667, range=0..10),
    strength=Slider(1, range=0..10),
    parallel=Toggle(True),
    Reference="C:\USERS\DAVID.RE\APPDATA\ROAMING\GRASSHOPPER\LIBRARIES\SPATIALSLUR\SpatialSlur.dll")  # -> out, result; inputs count: Int32, radius: Double, strength: Double, parallel: Boolean
# ---------- c_script: C# ----------
    var c = new SpatialSlur.SlurDynamics.Forces.SphereCollide(Enumerable.Range(0, count), radius, parallel, strength);
    result = new GH_ObjectWrapper(c.Yield());
# ---------- end c_script ----------

# ---- group: AbovePlane Constraint
c_script_2 = CSharpScript(
    count=int_3,
    plane=pln_2,
    weight=Slider(100, range=0..100),
    Reference="C:\Users\david.re\AppData\Roaming\Grasshopper\Libraries\SpatialSlur\SpatialSlur.dll")  # -> out, result; inputs count: Int32, plane: Plane, weight: Double
# ---------- c_script_2: C# ----------
    var o = (Vec3d) plane.Origin;
    var n = (Vec3d) plane.Normal;
    
    result = new GH_ObjectWrapper(
      Enumerable.Range(0, count)
      .Select(i => new AbovePlane(i, o, n, weight))
    );
# ---------- end c_script_2 ----------

# ----
merge = Merge(
    Data1=ColourSwatch(SwatchColor=RGB(255, 255, 255)),
    Data2=ColourSwatch(SwatchColor=RGB(255, 0, 150)),
    Data3=ColourSwatch(SwatchColor=RGB(0, 0, 0)))
int_4 = Integer(int)
box_3 = Box(box_2)
dup = DuplicateData(Data=merge, Number=Slider(5, range=0..100), Order=True)

# ---- group: Settings
c_script_3 = CSharpScript(
    timeStep=Slider(1, range=0..1),
    damping=Slider(0.1, range=0..1),
    Reference="C:\USERS\DAVID.RE\APPDATA\ROAMING\GRASSHOPPER\LIBRARIES\SPATIALSLUR\SpatialSlur.dll")  # -> out, result; inputs timeStep: Double, damping: Double
# ---------- c_script_3: C# ----------
    result = new ConstraintSolverSettings(){TimeStep = timeStep, Damping = damping};
# ---------- end c_script_3 ----------

# ---- group: Create Particles
c_script_4 = CSharpScript(
    bounds=box_3,
    count=int_4,
    seed=Slider(1, range=0..10),
    Reference="C:\USERS\DAVID.RE\APPDATA\ROAMING\GRASSHOPPER\LIBRARIES\SPATIALSLUR\SpatialSlur.dll")  # -> out, result; inputs bounds: Box, count: Int32, seed: Int32
# ---------- c_script_4: C# ----------
    var particles = new SpatialSlur.SlurDynamics.Particle[count];

    var random = new Random(seed);
    var d = bounds.BoundingBox.ToInterval3d();

    for(int i = 0; i < count; i++)
      particles[i] = new SpatialSlur.SlurDynamics.Particle(random.NextVec3d(d));

    result = new GH_ObjectWrapper(particles);
# ---------- end c_script_4 ----------

# ---- group: Gather Constraints
c_script_5 = CSharpScript(
    constraints=flatten([c_script.result, c_script_2.result]),
    Reference="C:\USERS\DAVID.RE\APPDATA\ROAMING\GRASSHOPPER\LIBRARIES\SPATIALSLUR\SpatialSlur.dll")  # -> out, result; inputs constraints: list
# ---------- c_script_5: C# ----------
    result = new GH_ObjectWrapper(constraints.SelectMany(obj => (IEnumerable<IConstraint>) obj).ToList());
# ---------- end c_script_5 ----------

# ----
col = Colour(dup)
data = Data(c_script_5.result)
list = ValueList({"Reset": 0, "Play": 1, "Pause": 2}, selected="Reset")
data_2 = Data(c_script_4.result)
data_3 = Data(data)
data_4 = Data(c_script_3.result)
col_2 = Colour(col)
# Notes: Point cloud colors not working in Rhino 6
c_script_6 = CSharpScript(
    particles=data_2,
    constraints=data_3,
    settings=data_4,
    subSteps=Slider(1, range=0..100),
    colors=col_2,
    pointSize=Slider(12, range=0..16),
    simState=list,
    Reference="C:\USERS\DAVID.RE\APPDATA\ROAMING\GRASSHOPPER\LIBRARIES\SPATIALSLUR\SpatialSlur.dll")  # -> out, result; inputs subSteps: Int32, colors: list of Color, pointSize: Int32, simState: Int32
# ---------- c_script_6: C# ----------
    //reset
    if(simState == 0)
    {
      Reset();
      return;
    }

    // setup
    if(_solver == null)
    {
      Init((IEnumerable<IBody>) particles);
    }

    // update constraints & settings
    _constraints = ((IEnumerable<IConstraint>) constraints).ToList();
    _solver.Settings = (ConstraintSolverSettings) settings;

    // step solver
    for(int i = 0; i < subSteps; i++)
      _solver.Step(_particles, _constraints, true);

    // print details
    Print(String.Format("Step {0}", _solver.StepCount));

    // expire solution
    if(simState == 1)
      Component.ExpireSolution(true);

    // update display
    UpdateDisplay(colors, pointSize);
    // UpdateDisplay();
# ---------- c_script_6: C# additional code ----------
  List<Particle> _particles;
  List<IConstraint> _constraints;
  ConstraintSolver _solver;

  PointCloud _pointCloud;
  BoundingBox _clippingBox;

  int _pointSize = 8;


  /// <summary>
  ///
  /// </summary>
  /// <returns></returns>
  void Reset()
  {
    _solver = null;
    _pointCloud = null;
  }


  /// <summary>
  ///
  /// </summary>
  /// <param name="particlePositions"></param>
  /// <param name="constraints"></param>
  /// <returns></returns>
  void Init(IEnumerable<IBody> particles)
  {
    _particles = particles.Select(p => new Particle(p.Position)).ToList();
    _solver = new ConstraintSolver();
    InitDisplay();
  }


  /// <summary>
  ///
  /// </summary>
  /// <returns></returns>
  void InitDisplay()
  {
    _pointCloud = new PointCloud(_particles.Select(p => (Point3d) p.Position));
    _clippingBox = _pointCloud.GetBoundingBox(false);
  }


  /// <summary>
  ///
  /// </summary>
  /// <returns></returns>
  void UpdateDisplay(List<Color> colors, int pointSize)
  {
    // Ideally, this stuff is done in a shader as per
    // https://github.com/mcneel/ghgl

    var interval = UpdateParticleDistances();

    // update point cloud items
    var chunks = System.Collections.Concurrent.Partitioner.Create(0, _particles.Count);
    System.Threading.Tasks.Parallel.ForEach(chunks, range =>
      {
      for(int i = range.Item1; i < range.Item2; i++)
      {
        var p0 = _particles[i];
        var p1 = _pointCloud[i];

        p1.Location = p0.Position;
        p1.Color = colors.Lerp(interval.Normalize(p0.Distance));
      }
      });

    _clippingBox = _pointCloud.GetBoundingBox(false);
    _pointSize = pointSize;
  }


  /// <summary>
  /// Returns distance interval
  /// </summary>
  /// <returns></returns>
  Intervald UpdateParticleDistances()
  {
    Vec3d camPos = RhinoDocument.Views.ActiveView.ActiveViewport.CameraLocation;
    var interval = new Intervald(camPos.DistanceTo(_particles[0].Position));

    foreach(var p in _particles)
    {
      var d = camPos.DistanceTo(p.Position);
      interval.Include(d);
      p.Distance = d;
    }

    return interval;
  }


  /// <summary>
  ///
  /// </summary>
  /// <returns></returns>
  void UpdateDisplay()
  {
    _clippingBox = BoundingBox.Empty;

    for(int i = 0; i < _particles.Count; i++)
    {
      Point3d pt = _particles[i].Position;
      _pointCloud[i].Location = pt;
      _clippingBox.Union(pt);
    }
  }


  /// <summary>
  ///
  /// </summary>
  public override BoundingBox ClippingBox
  {
    get {return _clippingBox;}
  }


  //Draw all meshes in this method.
  public override void DrawViewportMeshes(IGH_PreviewArgs args)
  {
    if(_pointCloud != null)
      args.Display.DrawPointCloud(_pointCloud, _pointSize);
  }


  /// <summary>
  ///
  /// </summary>
  /// <param name="args"></param>
  /// <returns></returns>
  public override void DrawViewportWires(IGH_PreviewArgs args)
  {
    //if(_pointCloud != null)
    //args.Display.DrawPointCloud(_pointCloud, _pointSize);
  }



  /// <summary>
  /// Extended particle that holds additional information for display purposes.
  /// </summary>
  class Particle : SpatialSlur.SlurDynamics.Particle
  {
    public double Distance;


    /// <summary>
    ///
    /// </summary>
    /// <param name="position"></param>
    public Particle(Vec3d position)
      :base(position)
    {
    }
  }
# ---------- end c_script_6 ----------
panel = Panel(c_script_6.out)
