# Grasshopper definition Steiner_Tree_Finder_01.gh (Grasshopper 0.9.76)
# plug-ins: SpatialSlur.SlurGH

num = Number(0.01)
c_script = CSharpScript(
    minLength=num,
    timeStep=Slider(1, range=0..1),
    damping=Slider(0.75, range=0..1),
    refineFreq=Slider(5, range=0..10),
    Reference="C:\USERS\DAVID.RE\APPDATA\ROAMING\GRASSHOPPER\LIBRARIES\SPATIALSLUR\SpatialSlur.dll")  # -> out, result; inputs minLength: Double, timeStep: Double, damping: Double, refineFreq: Int32
# ---------- c_script: C# ----------
    var settings = new SteinerFinder.Settings()
    {
      MinLength = minLength,
      TimeStep = timeStep,
      Damping = damping,
      RefineFrequency = refineFreq
    };

    result = settings;
# ---------- end c_script ----------
list = ValueList({"Reset": 0, "Play": 1, "Pause": 2}, selected="Pause")
pt = Point([Point(-5, -5, -10), Point(-5, 5, -10), Point(5, -5, -10), Point(5, 5, -10), Point(-5, -10, -5), Point(5, -10, -5), Point(-5, -10, 5), Point(5, -10, 5), Point(10, -5, -5), Point(10, 5, -5), Point(10, -5, 5), Point(10, 5, 5), Point(5, 10, -5), Point(-5, 10, -5), Point(5, 10, 5), Point(-5, 10, 5), Point(-10, 5, -5), Point(-10, -5, -5), Point(-10, 5, 5), Point(-10, -5, 5), Point(-5, -5, 10), Point(5, -5, 10), Point(-5, 5, 10), Point(5, 5, 10)])

# ---- group: Steiner Finder
c_script_2 = CSharpScript(
    points=pt,
    settings=c_script.result,
    subSteps=Slider(5, range=0..100),
    simState=list,
    Reference="C:\Users\david.re\AppData\Roaming\Grasshopper\Libraries\SpatialSlur\SpatialSlur.dll")  # -> out, result; inputs points: list of Point3d, subSteps: Int32, simState: Int32
# ---------- c_script_2: C# ----------
    // reset
    if(simState == 0)
    {
      _solver = null;
      return;
    }

    // setup
    if(_solver == null)
    {
      _solver = SteinerFinder.Solver.CreateFromPoints(points.Select(p => (Vec3d) p));
    }

    // update settings
    _solver.Settings = (SteinerFinder.Settings) settings;

    // step
    for(int i = 0; i < subSteps; i++)
      _solver.Step();

    // output
    Print((_solver.IsConverged) ? "Converged" : "Running");
    Print(String.Format("{0} steps", _solver.StepCount));
    result = HeGraph3d.Factory.CreateCopy(_solver.Graph, (v0,v1) => v0.Position = v1.Position, delegate{});

    // expire solution if playing
    if(simState == 1)
      Component.ExpireSolution(true);
# ---------- c_script_2: C# additional code ----------
  SteinerFinder.Solver _solver;
# ---------- end c_script_2 ----------

# ----
hegraph = HeGraph(c_script_2.result)
edgelns = EdgeLines(HeGraph=hegraph)
vertpos = VertexPositions(HeGraph=hegraph)
panel = Panel(c_script_2.out)
